# Grasshopper definition GableRoof45d.gh (Grasshopper 1.0.7)

pt = Point(Point(300, 125, 0))
pt_2 = Point(Point(5.9, 5.9, 0))
pt_3 = Point(Point(-5.9, 5.9, 0))
pt_4 = Point(Point(-5.9, -5.9, 0))
pt_5 = Point(Point(300, -125, 0))
pt_6 = Point(Point(5.9, -5.9, 0))
pt_7 = Point(Point(-600, 125, 0))
pt_8 = Point(Point(-600, -125, 0))
ln = Line(StartPoint=pt_2, EndPoint=pt_3)
ln_2 = Line(StartPoint=pt_3, EndPoint=pt_4)
ln_3 = Line(StartPoint=pt_4, EndPoint=pt_6)
ln_4 = Line(StartPoint=pt_2, EndPoint=pt_6)
srf4pt = _4PointSurface(CornerA=pt, CornerB=pt_5, CornerC=pt_8, CornerD=pt_7)
Z = UnitZ(Factor=1)
Z_2 = UnitZ(Factor="170")
extr = Extrude(Base=srf4pt, Direction=Z_2)
line = LineSDL(Start=pt_2, Direction=Z, Length="5.9")
line_2 = LineSDL(Start=pt_3, Direction=Z, Length="5.9")
line_3 = LineSDL(Start=pt_6, Direction=Z, Length="5.9")
line_4 = LineSDL(Start=pt_4, Direction=Z, Length="5.9")
cap = CapHoles(Brep=extr)
end = EndPoints(Curve=line_2)  # -> Start, End
end_2 = EndPoints(Curve=line)  # -> Start, End
end_3 = EndPoints(Curve=line_4)  # -> Start, End
end_4 = EndPoints(Curve=line_3)  # -> Start, End
ln_5 = Line(StartPoint=end_2.End, EndPoint=end.End)
ln_6 = Line(StartPoint=end.End, EndPoint=end_3.End)
ln_7 = Line(StartPoint=end_3.End, EndPoint=end_4.End)
ln_8 = Line(StartPoint=end_2.End, EndPoint=end_4.End)
curvepoint = PointOnCurve(ln_8, parameter=0.5)
curvepoint_2 = PointOnCurve(ln_6, parameter=0.5)
srf4pt_2 = _4PointSurface(CornerA=end_4.Start, CornerB=end_4.End, CornerC=end_2.End, CornerD=end_2.Start)
Z_3 = UnitZ(Factor=1)
Z_4 = UnitZ(Factor=1)
line_5 = LineSDL(Start=curvepoint_2, Direction=Z_3, Length="5.9")
end_5 = EndPoints(Curve=ln_7)  # -> Start, End
line_6 = LineSDL(Start=curvepoint, Direction=Z_4, Length="5.9")
end_6 = EndPoints(Curve=ln_5)  # -> Start, End
srf4pt_3 = _4PointSurface(CornerA=end.Start, CornerB=end.End, CornerC=end_3.End, CornerD=end_3.Start)
end_7 = EndPoints(Curve=line_5)  # -> Start, End
end_8 = EndPoints(Curve=line_6)  # -> Start, End
srf4pt_4 = _4PointSurface(CornerA=end_4.End, CornerB=end_8.End, CornerC=end_2.End, CornerD=end_8.Start)
srf4pt_5 = _4PointSurface(CornerA=end.End, CornerB=end_7.End, CornerC=end_3.End, CornerD=end_7.Start)
ln_9 = Line(StartPoint=end_6.Start, EndPoint=end_8.End)
ln_10 = Line(StartPoint=end_6.End, EndPoint=end_7.End)
ln_11 = Line(StartPoint=end_5.End, EndPoint=end_8.End)
ln_12 = Line(StartPoint=end_5.Start, EndPoint=end_7.End)
ln_13 = Line(StartPoint=end_7.End, EndPoint=end_8.End)
join = JoinCurves(Curves=[ln_10, ln_12], Preserve=False)  # -> flatten(Curves)
join_2 = JoinCurves(Curves=[ln_9, ln_11], Preserve=False)  # -> flatten(Curves)

srf4pt_6 = _4PointSurface(CornerA=end_2.End, CornerB=end_8.End, CornerC=end_7.End, CornerD=end.End)
srf4pt_7 = _4PointSurface(CornerA=end_3.End, CornerB=end_7.End, CornerC=end_8.End, CornerD=end_4.End)

srf4pt_8 = _4PointSurface(CornerA=end_3.Start, CornerB=end_3.End, CornerC=end_4.End, CornerD=end_4.Start)
srf4pt_9 = _4PointSurface(CornerA=end_2.Start, CornerB=end_2.End, CornerC=end.End, CornerD=end.Start)

join_3 = BrepJoin(Breps=[srf4pt_3, srf4pt_5])  # -> Breps, Closed
join_4 = BrepJoin(Breps=[srf4pt_2, srf4pt_4])  # -> Breps, Closed

edgesrf = EdgeSurface(CurveA=ln, CurveB=ln_2, CurveC=ln_3, CurveD=ln_4)
edgesrf_2 = EdgeSurface(CurveA=join_2, CurveB=join, CurveC=ln_7, CurveD=ln_5)
neg = Negative(Value="20")
join_5 = BrepJoin(Breps=[srf4pt_8, srf4pt_9, join_3.Breps, join_4.Breps, srf4pt_6, srf4pt_7])  # -> Breps, Closed
Z_5 = UnitZ(Factor=neg)
extr_2 = Extrude(Base=edgesrf_2, Direction=Z_5)
join_6 = BrepJoin(Breps=[edgesrf, extr_2, edgesrf_2])  # -> Breps, Closed
debrep = DeconstructBrep(Brep=join_5.Breps)  # -> Faces, Edges, Vertices
capex = CapHolesEx(Brep=join_6.Breps)  # -> Brep, Caps, Solid
python = GhPythonScript(G=debrep.Faces, CsvPath="C:\Users\magnu\Downloads", WriteFile=Toggle(False), OnlyUntrimmed=Toggle(False))  # -> out, Log; inputs G: list
# ---------- python: Python ----------
__author__ = "magnu"
__version__ = "2026.03.19"

import rhinoscriptsyntax as rs
"""
GhPython inputs:
    G              : list of geometry (Surface, BrepFace, Brep)
    CsvPath        : output folder or file-stem path
    WriteFile      : bool
    OnlyUntrimmed  : bool

GhPython outputs:
    Rows, Count, Log, OutPath
"""

import Rhino.Geometry as rg
import csv
import os

# ---------------------------
# Utility
# ---------------------------

def safe_call(fn, default=None):
    try:
        return fn()
    except:
        return default

def is_guid_like(x):
    # Works in IronPython for most Guid/reference cases
    try:
        s = str(x)
        return len(s) >= 32 and "-" in s
    except:
        return False

def resolve_geometry(geo_item):
    # If already geometry, return directly
    if isinstance(geo_item, rg.GeometryBase):
        return geo_item

    # Try RhinoObject lookup through ghdoc
    try:
        rh_obj = ghdoc.Objects.Find(geo_item)
        if rh_obj is not None:
            return rh_obj.Geometry
    except:
        pass

    # Last attempt: if it is guid-like, still try find
    if is_guid_like(geo_item):
        try:
            rh_obj = ghdoc.Objects.Find(geo_item)
            if rh_obj is not None:
                return rh_obj.Geometry
        except:
            pass

    return None

def bool_or_none(v):
    if v is None:
        return None
    return bool(v)

def interval_to_minmax(iv):
    if iv is None:
        return (None, None)
    return (safe_call(lambda: iv.T0, None), safe_call(lambda: iv.T1, None))

def curve_sample_params(domain, sample_count):
    if domain is None:
        return []
    t0 = safe_call(lambda: domain.T0, None)
    t1 = safe_call(lambda: domain.T1, None)
    if t0 is None or t1 is None:
        return []
    if sample_count <= 1:
        return [t0]
    step = float(t1 - t0) / float(sample_count - 1)
    return [t0 + i * step for i in range(sample_count)]

# ---------------------------
# Geometry decomposition
# ---------------------------

def to_face_items(geo, only_untrimmed):
    """
    Returns list of dictionaries:
    {
        "input_face_index": int,
        "source_kind": str,
        "nurbs_surface": rg.NurbsSurface,
        "source_for_area": geometry used for area,
        "brep_face": rg.BrepFace or None
    }
    """
    items = []

    # Direct Surface
    if isinstance(geo, rg.Surface):
        ns = safe_call(lambda: geo.ToNurbsSurface(), None)
        if ns is not None:
            items.append({
                "input_face_index": 0,
                "source_kind": "Surface",
                "nurbs_surface": ns,
                "source_for_area": geo,
                "brep_face": None
            })
        return items

    # BrepFace
    if isinstance(geo, rg.BrepFace):
        is_surface_face = safe_call(lambda: geo.IsSurface, False)
        if (not only_untrimmed) or is_surface_face:
            # Underlying surface preserves full NURBS definition
            us = safe_call(lambda: geo.UnderlyingSurface(), None)
            ns = safe_call(lambda: us.ToNurbsSurface(), None) if us is not None else None
            if ns is not None:
                items.append({
                    "input_face_index": 0,
                    "source_kind": "BrepFace",
                    "nurbs_surface": ns,
                    "source_for_area": geo,
                    "brep_face": geo
                })
        return items

    # Brep
    if isinstance(geo, rg.Brep):
        face_count = safe_call(lambda: geo.Faces.Count, 0)
        for i in range(face_count):
            face = geo.Faces[i]
            is_surface_face = safe_call(lambda: face.IsSurface, False)
            if only_untrimmed and (not is_surface_face):
                continue
            us = safe_call(lambda: face.UnderlyingSurface(), None)
            ns = safe_call(lambda: us.ToNurbsSurface(), None) if us is not None else None
            if ns is not None:
                items.append({
                    "input_face_index": i,
                    "source_kind": "BrepFace",
                    "nurbs_surface": ns,
                    "source_for_area": face,
                    "brep_face": face
                })
        return items

    return items

# ---------------------------
# Feature extraction
# ---------------------------

def extract_surface_row(surface_id, input_index, face_index, source_kind, ns, src_for_area, brep_face):
    dom_u = safe_call(lambda: ns.Domain(0), None)
    dom_v = safe_call(lambda: ns.Domain(1), None)
    u_min, u_max = interval_to_minmax(dom_u)
    v_min, v_max = interval_to_minmax(dom_v)

    amp = safe_call(lambda: rg.AreaMassProperties.Compute(src_for_area), None)
    area_val = safe_call(lambda: amp.Area, None) if amp is not None else None

    # For BrepFace, keep trim metadata
    is_trimmed = None
    loop_count = None
    if brep_face is not None:
        is_surface_face = safe_call(lambda: brep_face.IsSurface, None)
        if is_surface_face is not None:
            is_trimmed = not bool(is_surface_face)
        loop_count = safe_call(lambda: brep_face.Loops.Count, None)

    row = {
        "surface_id": surface_id,
        "input_index": input_index,
        "face_index": face_index,
        "source_kind": source_kind,

        "degree_u": safe_call(lambda: ns.Degree(0), None),
        "degree_v": safe_call(lambda: ns.Degree(1), None),

        "cp_count_u": safe_call(lambda: ns.Points.CountU, None),
        "cp_count_v": safe_call(lambda: ns.Points.CountV, None),

        "is_rational": bool_or_none(safe_call(lambda: ns.IsRational, None)),
        "is_closed_u": bool_or_none(safe_call(lambda: ns.IsClosed(0), None)),
        "is_closed_v": bool_or_none(safe_call(lambda: ns.IsClosed(1), None)),
        "is_periodic_u": bool_or_none(safe_call(lambda: ns.IsPeriodic(0), None)),
        "is_periodic_v": bool_or_none(safe_call(lambda: ns.IsPeriodic(1), None)),

        "span_u": safe_call(lambda: ns.SpanCount(0), None),
        "span_v": safe_call(lambda: ns.SpanCount(1), None),

        "u_min": u_min,
        "u_max": u_max,
        "v_min": v_min,
        "v_max": v_max,

        "area": area_val,

        "is_trimmed_face": is_trimmed,
        "loop_count": loop_count
    }
    return row

def extract_control_points(surface_id, ns):
    rows = []
    cu = safe_call(lambda: ns.Points.CountU, 0)
    cv = safe_call(lambda: ns.Points.CountV, 0)

    for i in range(cu):
        for j in range(cv):
            cp = safe_call(lambda: ns.Points.GetControlPoint(i, j), None)
            if cp is None:
                continue
            loc = safe_call(lambda: cp.Location, None)
            rows.append({
                "surface_id": surface_id,
                "i": i,
                "j": j,
                "x": safe_call(lambda: loc.X, None),
                "y": safe_call(lambda: loc.Y, None),
                "z": safe_call(lambda: loc.Z, None),
                "w": safe_call(lambda: cp.Weight, None)
            })
    return rows

def extract_knots(surface_id, ns):
    rows = []

    ku = safe_call(lambda: ns.KnotsU, None)
    if ku is not None:
        kuc = safe_call(lambda: ku.Count, 0)
        for idx in range(kuc):
            rows.append({
                "surface_id": surface_id,
                "dir": "U",
                "knot_index": idx,
                "knot_value": safe_call(lambda: ku[idx], None)
            })

    kv = safe_call(lambda: ns.KnotsV, None)
    if kv is not None:
        kvc = safe_call(lambda: kv.Count, 0)
        for idx in range(kvc):
            rows.append({
                "surface_id": surface_id,
                "dir": "V",
                "knot_index": idx,
                "knot_value": safe_call(lambda: kv[idx], None)
            })

    return rows

def extract_trims(surface_id, brep_face, uv_samples_per_trim, edge_samples_per_trim):
    trim_uv_rows = []
    trim_3d_rows = []

    if brep_face is None:
        return trim_uv_rows, trim_3d_rows

    loops = safe_call(lambda: brep_face.Loops, None)
    if loops is None:
        return trim_uv_rows, trim_3d_rows

    loop_count = safe_call(lambda: loops.Count, 0)
    for li in range(loop_count):
        loop = loops[li]
        loop_type = safe_call(lambda: str(loop.LoopType), None)

        trims = safe_call(lambda: loop.Trims, None)
        trim_count = safe_call(lambda: trims.Count, 0) if trims is not None else 0

        for ti in range(trim_count):
            tr = trims[ti]
            trim_index = safe_call(lambda: tr.TrimIndex, ti)
            trim_type = safe_call(lambda: str(tr.TrimType), None)
            iso_status = safe_call(lambda: str(tr.IsoStatus), None)
            is_rev = bool_or_none(safe_call(lambda: tr.IsReversed(), None))

            # UV sampling on trim curve itself (2D parameter-space curve)
            dom = safe_call(lambda: tr.Domain, None)
            t_vals = curve_sample_params(dom, uv_samples_per_trim)

            for si, t in enumerate(t_vals):
                pt2 = safe_call(lambda: tr.PointAt(t), None)
                trim_uv_rows.append({
                    "surface_id": surface_id,
                    "loop_index": li,
                    "loop_type": loop_type,
                    "trim_index": trim_index,
                    "trim_type": trim_type,
                    "iso_status": iso_status,
                    "is_reversed": is_rev,
                    "sample_index": si,
                    "t": t,
                    "u": safe_call(lambda: pt2.X, None),
                    "v": safe_call(lambda: pt2.Y, None)
                })

            # Optional 3D edge sampling if edge exists
            edge = safe_call(lambda: tr.Edge, None)
            if edge is not None:
                edom = safe_call(lambda: edge.Domain, None)
                et_vals = curve_sample_params(edom, edge_samples_per_trim)
                edge_index = safe_call(lambda: edge.EdgeIndex, None)

                for si, et in enumerate(et_vals):
                    p3 = safe_call(lambda: edge.PointAt(et), None)
                    trim_3d_rows.append({
                        "surface_id": surface_id,
                        "loop_index": li,
                        "trim_index": trim_index,
                        "edge_index": edge_index,
                        "sample_index": si,
                        "t": et,
                        "x": safe_call(lambda: p3.X, None),
                        "y": safe_call(lambda: p3.Y, None),
                        "z": safe_call(lambda: p3.Z, None)
                    })

    return trim_uv_rows, trim_3d_rows

# ---------------------------
# CSV writing
# ---------------------------

def write_csv(path, rows, fieldnames):
    folder = os.path.dirname(path)
    if folder and (not os.path.exists(folder)):
        os.makedirs(folder)

    # IronPython 2.7 CSV writer expects binary mode on Windows
    with open(path, "wb") as f:
        writer = csv.DictWriter(f, fieldnames=fieldnames, extrasaction="ignore")
        writer.writeheader()
        for r in rows:
            writer.writerow(r)

def build_output_paths(csv_path):
    """
    CsvPath handling:
    - If CsvPath has extension, use its folder and stem prefix.
    - If CsvPath has no extension, treat as folder.
    """
    raw = "" if csv_path is None else str(csv_path).strip()
    if raw == "":
        return None, None

    ext = os.path.splitext(raw)[1].lower()
    if ext == ".csv":
        folder = os.path.dirname(raw)
        if folder == "":
            folder = "."
        stem = os.path.splitext(os.path.basename(raw))[0]
    else:
        folder = raw
        stem = "gh_nurbs_export"

    if not os.path.exists(folder):
        os.makedirs(folder)

    paths = {
        "surfaces": os.path.join(folder, stem + "_surfaces.csv"),
        "control_points": os.path.join(folder, stem + "_control_points.csv"),
        "knots": os.path.join(folder, stem + "_knots.csv"),
        "trims_uv": os.path.join(folder, stem + "_trims_uv.csv"),
        "trims_3d": os.path.join(folder, stem + "_trims_3d.csv")
    }
    return folder, paths

# ---------------------------
# Main
# ---------------------------

if G is None:
    G = []
if not isinstance(G, list):
    G = [G]

if OnlyUntrimmed is None:
    OnlyUntrimmed = True
if WriteFile is None:
    WriteFile = False

# Sampling density for trims. Increase for smoother boundary reconstruction.
UV_SAMPLES_PER_TRIM = 25
EDGE_SAMPLES_PER_TRIM = 25

surfaces_rows = []
cp_rows = []
knot_rows = []
trim_uv_rows = []
trim_3d_rows = []

log = []
out_path = ""

log.append("Processing {0} input geometries...".format(len(G)))
sid = 0

for gi, geo in enumerate(G):
    if geo is None:
        log.append("[{0}] Skipped null".format(gi))
        continue

    resolved = resolve_geometry(geo)
    if resolved is None:
        log.append("[{0}] Could not resolve geometry".format(gi))
        continue

    items = to_face_items(resolved, OnlyUntrimmed)
    if not items:
        log.append("[{0}] No valid surfaces after filtering".format(gi))
        continue

    log.append("[{0}] Extracted {1} face item(s)".format(gi, len(items)))

    for item in items:
        sid += 1
        ns = item["nurbs_surface"]
        brep_face = item["brep_face"]

        srow = extract_surface_row(
            sid,
            gi,
            item["input_face_index"],
            item["source_kind"],
            ns,
            item["source_for_area"],
            brep_face
        )
        surfaces_rows.append(srow)

        cps = extract_control_points(sid, ns)
        ks = extract_knots(sid, ns)
        tuv, t3d = extract_trims(sid, brep_face, UV_SAMPLES_PER_TRIM, EDGE_SAMPLES_PER_TRIM)

        cp_rows.extend(cps)
        knot_rows.extend(ks)
        trim_uv_rows.extend(tuv)
        trim_3d_rows.extend(t3d)

log.append("Summary:")
log.append("  surfaces: {0}".format(len(surfaces_rows)))
log.append("  control points: {0}".format(len(cp_rows)))
log.append("  knots: {0}".format(len(knot_rows)))
log.append("  trims_uv samples: {0}".format(len(trim_uv_rows)))
log.append("  trims_3d samples: {0}".format(len(trim_3d_rows)))

if WriteFile:
    folder, paths = build_output_paths(CsvPath)
    if paths is None:
        log.append("WriteFile=True but CsvPath is empty")
    else:
        try:
            write_csv(paths["surfaces"], surfaces_rows, [
                "surface_id", "input_index", "face_index", "source_kind",
                "degree_u", "degree_v", "cp_count_u", "cp_count_v",
                "is_rational", "is_closed_u", "is_closed_v",
                "is_periodic_u", "is_periodic_v",
                "span_u", "span_v",
                "u_min", "u_max", "v_min", "v_max",
                "area", "is_trimmed_face", "loop_count"
            ])

            write_csv(paths["control_points"], cp_rows, [
                "surface_id", "i", "j", "x", "y", "z", "w"
            ])

            write_csv(paths["knots"], knot_rows, [
                "surface_id", "dir", "knot_index", "knot_value"
            ])

            write_csv(paths["trims_uv"], trim_uv_rows, [
                "surface_id", "loop_index", "loop_type",
                "trim_index", "trim_type", "iso_status", "is_reversed",
                "sample_index", "t", "u", "v"
            ])

            write_csv(paths["trims_3d"], trim_3d_rows, [
                "surface_id", "loop_index", "trim_index", "edge_index",
                "sample_index", "t", "x", "y", "z"
            ])

            out_path = folder
            log.append("CSV export completed in folder: {0}".format(folder))
        except Exception as e:
            log.append("CSV write failed: {0}".format(str(e)))
            out_path = ""

# Keep compatibility with your old outputs:
# Rows now returns surfaces table rows.
Rows = surfaces_rows
Count = len(surfaces_rows)
Log = "\n".join(log)
OutPath = out_path
# ---------- end python ----------
panel = Panel(python.Log)
